# Grasshopper definition 009_Lists_append.gh (Grasshopper 1.0.7)
# plug-ins: RhinoCodePluginGH

# Oscillation Algorithm
# The oscillation algorithm can be use to animate
# any geometry that is driven by a number sliders.
# Simply swap out the number sliders at the
# multiplication node in the oscillation script.
panel = Panel("1")  # disabled
trigger = Trigger(Interval=20, TimerInterval=20, Target=data_recorder)  # disabled
data_recorder = DataRecorder(panel, DataLimit=-10, RecordData=False)  # disabled
number_slider = Slider(58, range=0..1000)  # disabled
list_length = ListLength(List=data_recorder)  # disabled
division = Division(A=list_length, B=number_slider)  # disabled
cosine = Cosine(Value=division)  # disabled
sine = Sine(Value=division)  # disabled
panel_2 = Panel([sine, cosine])  # disabled
multiplication = Multiplication(A=sine)  # disabled
multiplication_2 = Multiplication(A=cosine)  # disabled
# gpt-4 2nd Response
# Sure, let's create a more complex model using
# trigonometric functions and the numpy library.
# We'll construct a spiral-like form using
# trigonometric polynomial functions.
# 
# This model will be generated using the formula:
# r(t)=a+b×sin(n×t)
# z(t)=t
multiplication_3 = Multiplication(A=sine)  # disabled
multiplication_4 = Multiplication(A=cosine)  # disabled
# 2nd gpt-4 Text Prompt
# Great, now create a much more complex model
# with complex trigonometric polynomials and the
# NUMPY python library. And be sure to use the
# append() function several times.
z_length = Slider(9.019, range=0..10)
y_length = Slider(2.757, range=0..10)
# gpt-4 Initial Response
# Certainly! Here's a simple script that generates
# a geometric 3D model. This example will create
# a parametric array of spheres in 3D space using
#  a  list and the append() function in a
# Grasshopper Python node. We will use the
# RhinoCommon API to create the geometry.
number_slider_2 = Slider(4, range=0..10)

# ----
# #The Numpy Array:
# A Multidimensional Array Object
# test_random
number_slider_3 = Slider(4, range=0..4)
numpy = Script(rows=number_slider_3, columns=Slider(11, range=0..20))  # -> out, a, arr0_OUT, arr1_OUT, arr2_OUT, arr3_OUT; inputs rows: Int32, columns: Int32
# ---------- numpy: Python ----------
"""Grasshopper Script"""
#! python 3
a = "Welcome to Wickerson Studios!"
print(a)

# r: numpy

import numpy

arr = numpy.random.rand(rows, columns)

print(arr)
print(type(arr))
arr = arr.tolist()
print(arr)

arr_OUT = [arr[i] if i < rows else False for i in range(4)]
arr0_OUT, arr1_OUT, arr2_OUT, arr3_OUT = arr_OUT
# ---------- end numpy ----------
panel_3 = Panel(numpy.a)
number = Number(numpy.arr0_OUT)
# 002 Python Refresher
# Container Data Structures
# Lists append() function
# gpt-4 Text Prompt
# Create a geometric 3D model with
# 
# Container Data Structures
# with
# Lists append() function
# 
# for  a python 3 script for the python 3 script
# node in grasshopper for Rhino8WIP using the
# 
# Rhino Common API.
# 
# Output the parts of the model in different
# variable outputs in the python 3 node in
# grasshopper.
panel_4 = Panel(number)
number_2 = Number(numpy.arr1_OUT)
panel_5 = Panel(number_2)
number_3 = Number(numpy.arr2_OUT)
panel_6 = Panel(number_3)
number_4 = Number(numpy.arr3_OUT)
number_slider_4 = Slider(10, range=0..100)
panel_7 = Panel(number_4)
multiplication_5 = Multiplication(A=number, B=number_slider_4)
multiplication_6 = Multiplication(A=number_2, B=number_slider_4)
construct_point = ConstructPoint(XCoordinate=multiplication_5, YCoordinate=graft(multiplication_5), ZCoordinate=0)
construct_point_2 = ConstructPoint(XCoordinate=multiplication_5, YCoordinate=graft(multiplication_5), ZCoordinate=multiplication_6)
unit_x = UnitX(Factor=number_3)
line = Line(StartPoint=construct_point, EndPoint=construct_point_2)
move = Move(Geometry=line, Motion=unit_x)  # -> Geometry, Transform
list_item = ListItem(List=graft(line), Index=0, Wrap=True)
list_item_2 = ListItem(List=graft(move.Geometry), Index=0, Wrap=True)
unit_y = UnitY(Factor=number_4)
loft = Loft(
    Curves=[list_item, list_item_2],
    Options={Adjust=False, Closed=False, LoftEnds=0, LoftSimp=0, LoftType=0, Rebuild=10, Refit=0.01})
extrude = Extrude(Base=loft, Direction=graft(unit_y))

list_append = Script(num_cylinders=number_slider_2, base_radius=y_length, height=z_length)  # -> out, a, b, c, d, e; inputs num_cylinders: Int32, base_radius: Double, height: Double
# ---------- list_append: Python ----------
import Rhino.Geometry as rg
import scriptcontext as sc

def create_cylinder(pt, radius, height):
    """Create a cylinder with given base point, radius, and height."""
    circle = rg.Circle(pt, radius)
    cylinder = rg.Cylinder(circle, height)
    return rg.Brep.CreateFromCylinder(cylinder, False, False)

def main(num_cylinders, base_radius, height):
    """Generate the series of cylinders and return as a list."""
    cylinders = []
    for i in range(num_cylinders):
        pt = rg.Point3d(0, i * (base_radius*2 + 10), 0)  # Adjusting y-coordinates to avoid overlap
        radius = base_radius + i
        cylinders.append(create_cylinder(pt, radius, height))
    return cylinders

# Number of cylinders, base radius, and height of each cylinder
"""
num_cylinders = 5
base_radius = 5
height = 20
"""

# Call the main function
cylinders_list = main(num_cylinders, base_radius, height)

# Output for Grasshopper (for simplicity, assuming we've a maximum of 5 cylinders)
a = cylinders_list[0] if len(cylinders_list) > 0 else None
b = cylinders_list[1] if len(cylinders_list) > 1 else None
c = cylinders_list[2] if len(cylinders_list) > 2 else None
d = cylinders_list[3] if len(cylinders_list) > 3 else None
e = cylinders_list[4] if len(cylinders_list) > 4 else None
# ---------- end list_append ----------
list_append_2 = Script()  # -> reverse(out), a, b, c
# ---------- list_append_2: Python ----------
# r: numpy

import Rhino.Geometry as rg
import numpy as np

def create_spiral(a, b, n, height, t_max=10*np.pi, samples=1000):
    """Create a trigonometric spiral using the provided parameters."""
    t_vals = np.linspace(0, t_max, samples)
    
    x_vals = (a + b * np.sin(n * t_vals)) * np.cos(t_vals)
    y_vals = (a + b * np.sin(n * t_vals)) * np.sin(t_vals)
    z_vals = np.linspace(0, height, samples)

    points = [rg.Point3d(x, y, z) for x, y, z in zip(x_vals, y_vals, z_vals)]
    curve = rg.Curve.CreateInterpolatedCurve(points, 3)
    return curve

def main():
    """Generate the series of spirals and return them as a list."""
    spirals = []
    parameters = [(3, 2, 2, 10), (4, 1, 3, 15), (5, 2, 4, 20)]
    
    z_offset = 0
    for param in parameters:
        spiral = create_spiral(*param)
        if spiral is not None:
            move_transform = rg.Transform.Translation(0, 0, z_offset)
            spiral.Transform(move_transform)
            spirals.append(spiral)
            z_offset += param[3]
            
    return spirals

spirals_list = main()

# Output for Grasshopper (assuming we have a maximum of 3 spirals for simplicity)
a = spirals_list[0] if len(spirals_list) > 0 else None
b = spirals_list[1] if len(spirals_list) > 1 else None
c = spirals_list[2] if len(spirals_list) > 2 else None
# ---------- end list_append_2 ----------
entwine = Entwine(
    Branch00=list_append.a,
    Branch01=list_append.b,
    Branch02=list_append.c,
    Branch03=list_append.d,
    Branch04=list_append.e,
    FlattenInputs=True)
panel_8 = Panel(list_append.out)
panel_9 = Panel(list_append_2.out)
entwine_2 = Entwine(Branch00=list_append_2.a, Branch01=list_append_2.b, Branch02=list_append_2.c, FlattenInputs=True)
panel_10 = Panel(entwine)
panel_11 = Panel(entwine_2)
